# Grasshopper definition Comprehensive Index K.gh (Grasshopper 1.0.7)
# plug-ins: Bifocals, LadybugGrasshopper, Colibri, Spectacles.GrasshopperExporter, Sampler, Writer

玻璃 = Panel("BOLI")
玻璃_2 = Panel("BOLI")
gapmat = HBWindowGapMaterial(thickness=Slider(0.012, range=0..0.1))  # -> mat; plug-in component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
glassmat = HBGlassMaterial(name=玻璃, thickness=Slider(0.004, range=0..1), conductivity="0.76")  # -> mat; plug-in component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
glassmat_2 = HBGlassMaterial(name=玻璃_2, thickness=Slider(0.004, range=0..1), conductivity="0.76")  # -> mat; plug-in component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
merge = Merge(Data1=glassmat, Data2=gapmat, Data3=glassmat_2)
windowconstr = HBWindowConstruction(materials=merge)  # -> constr; plug-in component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
subfacesubset = HBSubfaceSubset(window=windowconstr)  # -> subface_set; plug-in component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

number_slider = Slider(400, range=400..600)
dayschedule = HBDaySchedule(
    Decimals=1,
    Maximum=35,
    Minimum=0,
    Value=[35, 35, 35, 35, 35, 35, 35, 35, 35, 35, 35, 35, 35, 35, 35, 35, 35, 35, 35, 35, 35, 35, 35, 35])
房间进深 = Slider(6, range=6..10)
屋顶坡度 = Slider(0, range=0..60)
建筑朝向 = Slider(-45, range=-45..45)
房间高度 = Slider(2.8, range=2.8..4.5)
保温层厚度 = Slider(1, range=0..1)
前廊宽度采样值 = Slider(1, range=1..4)
南向窗墙比 = Slider(0.6, range=0.3..0.6)
制冷最高温度 = Slider(32, range=24..32)
制热最低温度 = Slider(18, range=18..20)
dayschedule_2 = HBDaySchedule(Decimals=1, Maximum=1, Minimum=0, Value=[1, 1, 1, 1, 1, 1, 1, 1, 1, 1, 1, 1, 1, 1, 1, 1, 1, 1, 1, 1, 1, 1, 1, 1])

dayschedule_3 = HBDaySchedule(Decimals=1, Maximum=1, Minimum=0, Value=[0, 0, 0, 0, 0, 0, 0, 0, 0, 0, 0, 0, 0, 0, 0, 0, 0, 0, 0, 1, 1, 1, 1, 0])
lb_falsestarttoggle = LBFalseStartToggle(False)
genepooltodaysch = HBGenePoolToDaySchedule(gene_pool=dayschedule_3, template=Slider(1, range=0..1), low_bound="0.00", up_bound="1.00", run=lb_falsestarttoggle)  # -> out; plug-in component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
weeklyschedule = HBWeeklySchedule(
    sun=dayschedule_3,
    mon=dayschedule_3,
    tue=dayschedule_3,
    wed=dayschedule_3,
    thu=dayschedule_3,
    fri=dayschedule_3,
    sat=dayschedule_3,
    name="2")  # -> out, schedule, idf_year, idf_week, idf_days; plug-in component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
W = Slider(3, range=0..10)
照明能量进入空气中的热量比 = Slider(0, range=0..1)
默认值为11_84029_w_m2 = Slider(10, range=0..100)
发出长波辐射热_0_32 = Slider(0.2, range=0..1)
发出短波辐射热0_25 = Slider(0.2, range=0..1)
lighting = HBLighting(
    name="zhao_ming",
    watts_per_area=W,
    schedule=weeklyschedule.schedule,
    radiant_fract=发出长波辐射热_0_32,
    visible_fract=发出短波辐射热0_25,
    return_fract=照明能量进入空气中的热量比,
    baseline=默认值为11_84029_w_m2)  # -> lighting; plug-in component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

dayschedule_4 = HBDaySchedule(Decimals=1, Maximum=1, Minimum=0, Value=[0, 0, 0, 0, 0, 0, 0, 0, 0, 0, 0, 0, 0, 0, 0, 0, 0, 0, 0, 0, 0, 0, 0, 0])
sampler = Sampler(
    Variables=[房间进深, 屋顶坡度, 建筑朝向, 房间高度, 保温层厚度, 前廊宽度采样值, 南向窗墙比, 制冷最高温度, 制热最低温度],
    Samples=Slider(1000, range=0..1000),
    Type=0,
    Seed=Slider(57, range=0..100),
    Filename="H:\桌面\新建文件夹 (2)\",
    Directory="csv.file")
panel = Panel(sampler)
panel_2 = Panel(panel)
flip_matrix = FlipMatrix(Data=panel_2)
list_item = ListItem(List=flip_matrix, Index=number_slider, Wrap=True)
panel_3 = Panel(list_item)
panel_4 = Panel(list_item)
panel_5 = Panel(list_item)
panel_6 = Panel(list_item)
panel_7 = Panel(list_item)
panel_8 = Panel(list_item)
panel_9 = Panel(list_item)
panel_10 = Panel(list_item)
panel_11 = Panel(list_item)
list_item_2 = ListItem(List=flatten(panel_10), Index=Slider(0, range=0..100), Wrap=True)
list_item_3 = ListItem(List=flatten(panel_7), Index=Slider(1, range=0..100), Wrap=True)
list_item_4 = ListItem(List=flatten(panel_9), Index=Slider(5, range=0..100), Wrap=True)
list_item_5 = ListItem(List=flatten(panel_5), Index=Slider(6, range=0..100), Wrap=True)
list_item_6 = ListItem(List=flatten(panel_6), Index=Slider(7, range=0..100), Wrap=True)
list_item_7 = ListItem(List=flatten(panel_3), Index=Slider(3, range=0..100), Wrap=True)
list_item_8 = ListItem(List=flatten(panel_8), Index=Slider(2, range=0..100), Wrap=True)
list_item_9 = ListItem(List=flatten(panel_4), Index=Slider(4, range=0..100), Wrap=True)
list_item_10 = ListItem(List=flatten(panel_11), Index=Slider(8, range=0..100), Wrap=True)
maximum_refrigeration_temperature = Panel(list_item_10)
制冷最高温度_2 = Panel(maximum_refrigeration_temperature)
duplicate_data = DuplicateData(Data=制冷最高温度_2, Number=Slider(24, range=0..100), Order=True)  # -> flatten(Data)
panel_12 = Panel(duplicate_data)
weeklyschedule_2 = HBWeeklySchedule(
    sun=panel_12,
    mon=panel_12,
    tue=panel_12,
    wed=panel_12,
    thu=panel_12,
    fri=panel_12,
    sat=panel_12,
    name="9",
    type_limit="Temperature")  # -> out, schedule, idf_year, idf_week, idf_days; plug-in component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
minimum_heating_temperature_value = Panel(list_item_6)
供暖最低温度 = Panel(minimum_heating_temperature_value)
duplicate_data_2 = DuplicateData(Data=供暖最低温度, Number=Slider(24, range=0..100), Order=True)  # -> flatten(Data)
panel_13 = Panel(duplicate_data_2)
weeklyschedule_3 = HBWeeklySchedule(
    sun=panel_13,
    mon=panel_13,
    tue=panel_13,
    wed=panel_13,
    thu=panel_13,
    fri=panel_13,
    sat=panel_13,
    name="8",
    type_limit="Temperature")  # -> out, schedule, idf_year, idf_week, idf_days; plug-in component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
sampling_value_of_front_porch_width = Panel(list_item_4)
south_facing_window_opening_ratio = Panel(list_item_5)
insulation_layer_thickness_sampling = Panel(list_item_9)
room_depth_sampling = Panel(list_item_2)
building_height_sampling = Panel(list_item_7)
building_orientation_sampling = Panel(list_item_8)
房间面积 = Slider(100, range=0..100)
writer = Writer(Data=sampler, Filepath="H:\桌面\新建文件夹 (2)\")
房间进深抽取值 = Panel(room_depth_sampling)
multiplication = Multiplication(A=list_item_3, B=Slider(1, range=0..100))
multiplication_2 = Multiplication(A=building_orientation_sampling, B=Slider(1, range=0..100))
setpoint = HBSetpoint(heating_sch=weeklyschedule_2.schedule, cooling_sch=weeklyschedule_3.schedule)  # -> setpoint; plug-in component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
lb_falsestarttoggle_2 = LBFalseStartToggle(False)
panel_14 = Panel(sampler)
multiplication_3 = Multiplication(A=insulation_layer_thickness_sampling, B=Slider(1, range=0..1))

瓦 = Panel("_qikuai")
防水层 = Panel("fangshuceng")
岩棉板 = Panel("yanmnianban")
抹灰层 = Panel("mohuiceng")
松_木_云杉_热流方向垂直木纹 = Panel("mohuiceng")
opaquemat = HBOpaqueMaterial(
    name=岩棉板,
    thickness=multiplication_3,
    conductivity=Slider(0.04, range=0..0.1),
    density=Slider(120, range=0..1000),
    spec_heat=Slider(750, range=0..1000))  # -> mat; plug-in component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
opaquemat_2 = HBOpaqueMaterial(name=防水层, thickness=Slider(0.004, range=0..1), conductivity="0.17", density="1470", spec_heat=Slider(600, range=0..1000))  # -> mat; plug-in component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
opaquemat_3 = HBOpaqueMaterial(name=瓦, thickness=Slider(0.005, range=0..1), conductivity="0.5", density="1700", spec_heat=Slider(1000, range=0..1000))  # -> mat; plug-in component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
opaquemat_4 = HBOpaqueMaterial(
    name=松_木_云杉_热流方向垂直木纹,
    thickness=Slider(0.005, range=0..1),
    conductivity="0.14",
    density="500",
    spec_heat=Slider(2510, range=0..10000))  # -> mat; plug-in component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
opaquemat_5 = HBOpaqueMaterial(
    name=抹灰层,
    thickness=Slider(0.004, range=0..1),
    conductivity="0.83",
    density="1800",
    spec_heat=Slider(1050, range=0..10000))  # -> mat; plug-in component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
opaqueconstr = HBOpaqueConstruction(materials=[opaquemat_3, opaquemat_2, opaquemat_5, opaquemat, opaquemat_4])  # -> constr; plug-in component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

碎石_卵石混凝土_ρ_2300 = Panel("hunningtudiban")
防水层_2 = Panel("fangshuceng")
岩棉板_2 = Panel("yanmnianban")
抹灰层_2 = Panel("mohuiceng")
opaquemat_6 = HBOpaqueMaterial(
    name=岩棉板_2,
    thickness=multiplication_3,
    conductivity=Slider(0.04, range=0..0.1),
    density=Slider(120, range=0..1000),
    spec_heat=Slider(750, range=0..1000))  # -> mat; plug-in component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
opaquemat_7 = HBOpaqueMaterial(
    name=防水层_2,
    thickness=Slider(0.004, range=0..1),
    conductivity="0.17",
    density="1470",
    spec_heat=Slider(600, range=0..1000))  # -> mat; plug-in component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
opaquemat_8 = HBOpaqueMaterial(
    name=碎石_卵石混凝土_ρ_2300,
    thickness=Slider(0.015, range=0..1),
    conductivity="1.51",
    density="2300",
    spec_heat=Slider(920, range=0..1000))  # -> mat; plug-in component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
opaquemat_9 = HBOpaqueMaterial(
    name=抹灰层_2,
    thickness=Slider(0.002, range=0..1),
    conductivity="0.83",
    density="1800",
    spec_heat=Slider(1050, range=0..10000))  # -> mat; plug-in component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
opaqueconstr_2 = HBOpaqueConstruction(materials=[opaquemat_8, opaquemat_7, opaquemat_9, opaquemat_6])  # -> constr; plug-in component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

防水层_3 = Panel("fangshuceng")
砌块层 = Panel("_qikuai")
岩棉板_3 = Panel("yanmnianban")
抹灰层_3 = Panel("mohuiceng")
opaquemat_10 = HBOpaqueMaterial(
    name=岩棉板_3,
    thickness=multiplication_3,
    conductivity=Slider(0.04, range=0..0.1),
    density=Slider(120, range=0..1000),
    spec_heat=Slider(750, range=0..1000))  # -> mat; plug-in component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
opaquemat_11 = HBOpaqueMaterial(
    name=防水层_3,
    thickness=Slider(0.004, range=0..1),
    conductivity="0.17",
    density="1470",
    spec_heat=Slider(600, range=0..1000))  # -> mat; plug-in component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
opaquemat_12 = HBOpaqueMaterial(name=砌块层, thickness=Slider(0.45, range=0..1), conductivity="0.23", density="1800", spec_heat=Slider(1000, range=0..1000))  # -> mat; plug-in component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
opaquemat_13 = HBOpaqueMaterial(
    name=抹灰层_3,
    thickness=Slider(0.004, range=0..1),
    conductivity="0.83",
    density="1800",
    spec_heat=Slider(1050, range=0..10000))  # -> mat; plug-in component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

# ----
# 墙体构造
# 屋顶构造
# 楼地层构造
opaqueconstr_3 = HBOpaqueConstruction(materials=[opaquemat_12, opaquemat_11, opaquemat_13, opaquemat_10])  # -> constr; plug-in component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
exteriorsubset = HBExteriorConstructionSubset(exterior_wall=opaqueconstr_3, exterior_roof=opaqueconstr, exposed_floor=opaqueconstr_2)  # -> exterior_set; plug-in component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
constructionset = HBConstructionSet(exterior_subset=exteriorsubset, subface_subset=subfacesubset)  # -> constr_set; plug-in component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

division = Division(A=房间面积, B=房间进深抽取值)
房间面宽 = Panel(division)
multiplication_4 = Multiplication(A=房间面宽, B=房间进深抽取值)
roof_slope_sample_value = Panel(multiplication)
房间面积_2 = Panel(multiplication_4)
genepooltodaysch_2 = HBGenePoolToDaySchedule(gene_pool=dayschedule, template=Slider(1, range=0..1), low_bound="0.00", up_bound="30", run=lb_falsestarttoggle_2)  # -> out; plug-in component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
colibri_iterator = ColibriIterator(Number_Slider=number_slider, RemoteFly=False, ignoreAllWarningMsg=False)  # -> NumberSlider, Value_N, IterationGenome
division_2 = Division(A=房间面积_2, B=Slider(25, range=0..100))

dayschedule_5 = HBDaySchedule(Decimals=1, Maximum=1, Minimum=0, Value=[0, 0, 0, 0, 0, 0, 0, 0, 0, 0, 0, 0, 0, 0, 0, 0, 0, 0, 0, 0, 1, 0, 0, 0])
weeklyschedule_4 = HBWeeklySchedule(
    sun=dayschedule_5,
    mon=dayschedule_5,
    tue=dayschedule_5,
    wed=dayschedule_5,
    thu=dayschedule_5,
    fri=dayschedule_5,
    sat=dayschedule_5,
    name="5")  # -> out, schedule, idf_year, idf_week, idf_days; plug-in component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
servicehotwater = HBServiceHotWater(
    name="re_shui",
    flow_per_area=Slider(0.01, range=0..0.01),
    schedule=weeklyschedule_4.schedule,
    target_temp=Slider(60, range=0..100),
    sensible_fract=Slider(0, range=0..1),
    latent_fract=Slider(0, range=0..0.1))  # -> hot_water; plug-in component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

domain_box = DomainBox(Base=PlaneXY(0, 0, 0), X=房间面宽, Y=房间进深抽取值, Z=building_height_sampling)
散失空气中的热量比default_0 = Slider(0, range=0..1)
compass = LBCompass(scale=Slider(1, range=0..10))  # -> compass; plug-in component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
number_slider_2 = Slider(1000, range=0..10000)
panel_15 = Panel(division_2)
value_list = ValueList({"Tight building": 0.0001, "Average building": 0.0003, "Leaky building": 0.0006}, selected="Tight building")
散失空气中的热量比default_0_2 = Slider(0, range=0..1)

dayschedule_6 = HBDaySchedule(Decimals=1, Maximum=1, Minimum=0, Value=[1, 1, 1, 1, 1, 1, 1, 1, 1, 1, 1, 1, 1, 1, 1, 1, 1, 1, 1, 1, 1, 1, 1, 1])
weeklyschedule_5 = HBWeeklySchedule(
    sun=dayschedule_6,
    mon=dayschedule_6,
    tue=dayschedule_6,
    wed=dayschedule_6,
    thu=dayschedule_6,
    fri=dayschedule_6,
    sat=dayschedule_6,
    name="6")  # -> out, schedule, idf_year, idf_week, idf_days; plug-in component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
infiltration = HBInfiltration(name="lou_qi", flow_per_ext_area=value_list, schedule=weeklyschedule_5.schedule)  # -> infil; plug-in component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

潜在的设备负荷default_0 = Slider(0, range=0..1)
机器向外辐射率default_0 = Slider(0.6, range=0..1)

dayschedule_7 = HBDaySchedule(Decimals=1, Maximum=1, Minimum=0, Value=[1, 1, 1, 1, 1, 1, 1, 1, 1, 1, 1, 1, 1, 1, 1, 1, 1, 1, 1, 1, 1, 1, 1, 1])
weeklyschedule_6 = HBWeeklySchedule(
    sun=dayschedule_7,
    mon=dayschedule_4,
    tue=dayschedule_4,
    wed=dayschedule_4,
    thu=dayschedule_7,
    fri=dayschedule_7,
    sat=dayschedule_7,
    name="3")  # -> out, schedule, idf_year, idf_week, idf_days; plug-in component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
潜在的设备负荷default_0_2 = Slider(0, range=0..1)
机器向外辐射率default_0_2 = Slider(0.6, range=0..1)
panel_16 = Panel("3.8")
equipment = HBEquipment(
    name="dian_she_bei",
    watts_per_area=panel_16,
    schedule=weeklyschedule_6.schedule,
    radiant_fract=机器向外辐射率default_0_2,
    latent_fract=潜在的设备负荷default_0_2,
    lost_fract=散失空气中的热量比default_0,
    gas=Toggle(False))  # -> equip; plug-in component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

ach或acph代表每小时换气次数 = Slider(0.983, range=0..1)

dayschedule_8 = HBDaySchedule(Decimals=1, Maximum=1, Minimum=0, Value=[1, 1, 1, 1, 1, 1, 1, 1, 1, 1, 1, 1, 1, 1, 1, 1, 1, 1, 1, 1, 1, 1, 1, 1])
weeklyschedule_7 = HBWeeklySchedule(
    sun=dayschedule_8,
    mon=dayschedule_8,
    tue=dayschedule_8,
    wed=dayschedule_8,
    thu=dayschedule_8,
    fri=dayschedule_8,
    sat=dayschedule_8,
    name="7")  # -> out, schedule, idf_year, idf_week, idf_days; plug-in component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
ventilation = HBVentilation(
    name="zi_ran_tong_feng",
    flow_per_person="1",
    flow_per_area="1",
    flow_per_zone="1",
    ach=ach或acph代表每小时换气次数,
    schedule=weeklyschedule_7.schedule)  # -> vent; plug-in component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

weeklyschedule_8 = HBWeeklySchedule(
    sun=dayschedule_2,
    mon=dayschedule_2,
    tue=dayschedule_2,
    wed=dayschedule_2,
    thu=dayschedule_2,
    fri=dayschedule_2,
    sat=dayschedule_2,
    name="4")  # -> out, schedule, idf_year, idf_week, idf_days; plug-in component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
panel_17 = Panel("10")
equipment_2 = HBEquipment(
    name="qi_she_bei",
    watts_per_area=panel_17,
    schedule=weeklyschedule_8.schedule,
    radiant_fract=机器向外辐射率default_0,
    latent_fract=潜在的设备负荷default_0,
    lost_fract=散失空气中的热量比default_0_2,
    gas=Toggle(True))  # -> equip; plug-in component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

volume = Volume(Geometry=domain_box)  # -> Volume, Centroid
area = Area(Geometry=domain_box)  # -> Area, Centroid
volume_2 = Volume(Geometry=domain_box)  # -> Volume, Centroid
image_setting = ImageSetting(ImageSaveAsName="defaultName", RhinoViewNames="Perspective", Width=number_slider_2, Height=number_slider_2)
division_3 = Division(A=panel_15, B=房间面积_2)
panel_18 = Panel(division_3)

dayschedule_9 = HBDaySchedule(Decimals=1, Maximum=1, Minimum=0, Value=[1, 1, 1, 1, 1, 1, 1, 1, 1, 1, 1, 1, 1, 1, 1, 1, 1, 1, 1, 1, 1, 1, 1, 1])
weeklyschedule_9 = HBWeeklySchedule(
    sun=dayschedule_9,
    mon=dayschedule_9,
    tue=dayschedule_9,
    wed=dayschedule_9,
    thu=dayschedule_9,
    fri=dayschedule_9,
    sat=dayschedule_9,
    name="1")  # -> out, schedule, idf_year, idf_week, idf_days; plug-in component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
people_人_m2 = Slider(0.02, range=0..0.1)
people = HBPeople(name="people", ppl_per_area=panel_18, occupancy_sch=weeklyschedule_9.schedule)  # -> people; plug-in component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

programtype = HBProgramType(people=people, lighting=lighting, electric_equip=equipment, infiltration=infiltration, setpoint=setpoint)  # -> program; plug-in component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
panel_19 = Panel(volume.Volume)
panel_20 = Panel(area.Area)
division_4 = Division(A=panel_20, B=panel_19)
体形系数 = Panel(division_4)
facparam = HBFacadeParameters(north=0, east=0, south=south_facing_window_opening_ratio, west=0)  # -> fac_par; plug-in component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
上下两个窗的距离 = Slider(0, range=0..10)
可开启 = Slider(1, range=0..1)
窗户中点距离 = Slider(6, range=0..10)
是否做小窗 = Slider(1, range=0..1)
窗台高度 = Slider(0.9, range=0..1)
roomsolid = HBRoomFromSolid(geo=flatten(domain_box), conditioned=Slider(1, range=0..1))  # -> out, rooms; plug-in component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
aperturesbyratio = HBAperturesByRatio(
    hb_objs=flatten(roomsolid.rooms),
    ratio=facparam,
    subdivide=是否做小窗,
    sill_height=窗台高度,
    horiz_separ=窗户中点距离,
    vert_separ=上下两个窗的距离,
    operable=可开启)  # -> out, hb_objs; plug-in component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
facesbytype = HBFacesByType(hb_objs=roomsolid.rooms)  # -> walls, interior_walls, roofs, ceilings, exterior_floors, interior_floors, air_walls, apertures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; plug-in component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
facesbytype_2 = HBFacesByType(hb_objs=aperturesbyratio.hb_objs)  # -> walls, interior_walls, roofs, ceilings, exterior_floors, interior_floors, air_walls, apertures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; plug-in component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
cluster = Cluster(degrees=roof_slope_sample_value, hb_objs=facesbytype_2.roofs, degrees_2=roof_slope_sample_value)  # -> surface_2, surface, points, points_2

deconstruct_brep = DeconstructBrep(Brep=domain_box)  # -> Faces, Edges, Vertices
list_item_11 = ListItem(List=deconstruct_brep.Vertices, Index=Slider(6, range=0..8), Wrap=True)
list_item_12 = ListItem(List=deconstruct_brep.Vertices, Index=Slider(5, range=0..8), Wrap=True)
point = Point(cluster.points_2)
_4point_surface = _4PointSurface(CornerA=list_item_11, CornerB=point, CornerC=list_item_12)

deconstruct_brep_2 = DeconstructBrep(Brep=domain_box)  # -> Faces, Edges, Vertices
list_item_13 = ListItem(List=deconstruct_brep_2.Vertices, Index=Slider(7, range=0..8), Wrap=True)
list_item_14 = ListItem(List=deconstruct_brep_2.Vertices, Index=Slider(4, range=0..8), Wrap=True)
point_2 = Point(cluster.points)
_4point_surface_2 = _4PointSurface(CornerA=list_item_13, CornerB=point_2, CornerC=list_item_14)

vizall = HBVisualizeAll(hb_objs=flatten(facesbytype.walls))  # -> geo; plug-in component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
vizall_2 = HBVisualizeAll(hb_objs=flatten(facesbytype_2.exterior_floors))  # -> geo; plug-in component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
vizall_3 = HBVisualizeAll(hb_objs=flatten(facesbytype_2.apertures))  # -> geo; plug-in component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
brep = Brep([_4point_surface_2, vizall, _4point_surface])
aperture = HBAperture(geo=vizall_3, operable=Slider(1, range=0..1))  # -> out, apertures; plug-in component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
brep_2 = Brep([cluster.surface_2, cluster.surface])
face = HBFace(geo=vizall_2, type="Floor")  # -> out, faces; plug-in component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
face_2 = HBFace(geo=brep_2, type="RoofCeiling")  # -> out, faces; plug-in component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
face_3 = HBFace(geo=brep, type="WALL")  # -> out, faces; plug-in component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
room = HBRoom(
    faces=flatten([face.faces, face_2.faces, face_3.faces]),
    constr_set=constructionset,
    program=programtype,
    conditioned=Slider(1, range=0..1))  # -> out, room; plug-in component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
cluster_2 = Cluster_5(brep=domain_box, factor=sampling_value_of_front_porch_width, factor_2=sampling_value_of_front_porch_width)  # -> surface, geometry
cluster_3 = Cluster_2(brep=domain_box, A_2=building_height_sampling, A=房间面宽)
shade = HBShade(geo=[cluster_2.surface, cluster_2.geometry])  # -> out, shades; plug-in component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
addsubface = HBAddSubface(hb_obj=flatten(room.room), sub_faces=flatten([aperture.apertures, cluster_3]))  # -> hb_obj; plug-in component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
建筑朝向_2 = Slider(0, range=-45..45)
model = HBModel(rooms=flatten(addsubface), shades=flatten(shade.shades))  # -> out, model; plug-in component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
rotate = HBRotate(hb_objs=flatten(model.model), angle=multiplication_2)  # -> hb_objs; plug-in component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
facesbytype_3 = HBFacesByType(hb_objs=rotate)  # -> walls, interior_walls, roofs, ceilings, exterior_floors, interior_floors, air_walls, apertures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; plug-in component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
vizall_4 = HBVisualizeAll(hb_objs=flatten([facesbytype_3.walls, facesbytype_3.interior_walls, facesbytype_3.roofs, facesbytype_3.ceilings, facesbytype_3.exterior_floors, facesbytype_3.interior_floors, facesbytype_3.air_walls, facesbytype_3.apertures, facesbytype_3.interior_apertures, facesbytype_3.doors, facesbytype_3.interior_doors, facesbytype_3.outdoor_shades, facesbytype_3.indoor_shades]))  # -> geo; plug-in component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
spectacles_meshcoloredfaces = Spectacles_MeshColoredFaces(Mesh=vizall_4, Colors=ColourSwatch(SwatchColor=RGB(255, 255, 255)))
spectacles_colibri_3dobjects = SpectaclesColibri_3DObjects(Elements=flatten(spectacles_meshcoloredfaces))
cluster_4 = Cluster_3()
cluster_5 = Cluster_4()
lb_falsestarttoggle_3 = LBFalseStartToggle(False)
deconstructmodel = HBDeconstructModel(model=rotate)  # -> rooms, faces, apertures, doors, shades; plug-in component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
residualcontrol = Butterfly_residualControl(values=1e-05)  # -> residual_control; plug-in component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
model_2 = HBModel(rooms=flatten(deconstructmodel.rooms), shades=flatten(deconstructmodel.shades))  # -> out, model; plug-in component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
modeltoosm = HBModelToOSM(model=model_2.model, epw_file=cluster_4, sim_par=cluster_5, write=lb_falsestarttoggle_3, run=lb_falsestarttoggle_3)  # -> out, jsons, osw, osm, idf, sql, zsz, rdd, html; plug-in component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
时间步 = Slider(30, range=0..100)
vizbytype = HBVisualizeByType(hb_objs=model_2.model)  # -> walls, interior_walls, roofs, ceilings, exterior_floors, interior_floors, air_walls, apertures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; plug-in component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
adaptpar = LBAdaptiveComfortParameters(neutral_offset=Slider(3.5, range=0..10), discr_or_cont_vel=Toggle(False), cold_prevail_limit=Slider(22, range=0..100))  # -> adapt_par; plug-in component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
importepw = LBImportEPW(epw_file=cluster_4)  # -> location, dry_bulb_temperature, dew_point_temperature, relative_humidity, wind_speed, wind_direction, direct_normal_rad, diffuse_horizontal_rad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; plug-in component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
eui = HBEndUseIntensity(sql=modeltoosm.sql)  # -> eui, eui_end_use, end_uses, gross_floor; plug-in component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
roomcomfortresult = HBReadRoomComfortResult(sql=modeltoosm.sql)  # -> oper_temp, air_temp, rad_temp, rel_humidity; plug-in component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
roomcomfortresult_2 = HBReadRoomComfortResult(sql=modeltoosm.sql)  # -> oper_temp, air_temp, rad_temp, rel_humidity; plug-in component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
adaptive = LBAdaptiveComfort(
    out_temp=importepw.dry_bulb_temperature,
    air_temp=roomcomfortresult.air_temp,
    mrt=roomcomfortresult.rad_temp,
    air_speed=importepw.wind_speed,
    adapt_par=adaptpar,
    run=Toggle(True))  # -> out, prevail_temp, neutral_temp, deg_neutral, comfort, condition, comf_obj; plug-in component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
panel_21 = Panel(roomcomfortresult_2.oper_temp)
屋顶坡度_2 = Slider(0, range=0..60)
facesbytype_4 = HBFacesByType(hb_objs=rotate)  # -> walls, interior_walls, roofs, ceilings, exterior_floors, interior_floors, air_walls, apertures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; plug-in component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
xdata = LBDeconstructData(data=adaptive.comfort)  # -> header, values; plug-in component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
mass_addition = MassAddition(Input=xdata.values)  # -> Result, PartialResults
# 建筑材料能耗
vizall_5 = HBVisualizeAll(hb_objs=flatten(facesbytype_4.walls))  # -> geo; plug-in component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
# 舒适百分比
panel_22 = Panel(mass_addition.Result)
vizall_6 = HBVisualizeAll(hb_objs=flatten(facesbytype_4.roofs))  # -> geo; plug-in component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
division_5 = Division(A=panel_22, B="8760")
舒适百分比 = Panel(division_5)
area_2 = Area(Geometry=vizall_6)  # -> Area, Centroid
radians = Radians(Degrees=roof_slope_sample_value)
砌块容重 = Slider(2200, range=0..10000)
cosine = Cosine(Value=radians)

# ----
# 建筑运行能耗
Y = Slider(50, range=0..100)
全年能耗kwh = Panel(eui.eui)
multiplication_5 = Multiplication(A=全年能耗kwh, B=房间面宽, C=房间进深抽取值, D=Y)
kwh = Panel(multiplication_5)
千瓦时转换 = Panel("3.6")
multiplication_6 = Multiplication(A=kwh, B=千瓦时转换)
兆焦 = Panel(multiplication_6)
division_6 = Division(A=兆焦, B=Slider(1000, range=0..1000))
太焦 = Panel(division_6)
division_7 = Division(A=太焦, B="94")
T = Panel(division_7)
multiplication_7 = Multiplication(A=T, B=Slider(1000, range=0..1000))
kg = Panel(multiplication_7)

mass_addition_2 = MassAddition(Input=area_2.Area)  # -> Result, PartialResults
# 建筑材料回收
number_slider_3 = Slider(0.2, range=0..1)

panel_23 = Panel(cosine)
民居进深 = Panel(房间进深抽取值)
木梁截面积_m2 = Panel("0.12")
民居面宽 = Panel(房间面宽)
屋顶总面积m2 = Panel(mass_addition_2.Result)
屋顶总面积m2_2 = Panel(mass_addition_2.Result)
屋顶总面积m2_3 = Panel(mass_addition_2.Result)
屋顶总面积m2_4 = Panel(mass_addition_2.Result)
屋顶总面积m2_5 = Panel(mass_addition_2.Result)
value_list_2 = ValueList({"防水层厚度": 0.004}, selected="防水层厚度")
value_list_3 = ValueList({"平板瓦": 9.8, "卢卡瓦": 11.5, "天筒瓦": 30, "罗曼瓦": 9.3}, selected="平板瓦")
屋顶总面积m2_6 = Panel(mass_addition_2.Result)
value_list_4 = ValueList({"挂瓦条": 4}, selected="挂瓦条")
value_list_5 = ValueList({"顺水条": 1.7}, selected="顺水条")
M = Slider(0.05, range=0..0.1)
M_2 = Slider(0.04, range=0..0.1)
M_3 = Slider(0.05, range=0..0.1)
M_4 = Slider(0.04, range=0..0.1)
multiplication_8 = Multiplication(民居面宽=民居面宽, 木梁截面积M2=木梁截面积_m2)
multiplication_9 = Multiplication(屋顶总面积M2=屋顶总面积m2, 屋顶保温层厚度=multiplication_3)
division_8 = Division(民居进深=民居进深, Cos=panel_23)
木梁截面积_m2_2 = Panel("0.06")
multiplication_10 = Multiplication(屋顶总面积M2=屋顶总面积m2_2, 每平米挂瓦条长度=value_list_4)
multiplication_11 = Multiplication(屋顶总面积M2=屋顶总面积m2_5, 防水层厚度4MM=value_list_2)
multiplication_12 = Multiplication(屋顶总面积M2=屋顶总面积m2_4, 每平米顺水条长度=value_list_5)
multiplication_13 = Multiplication(屋顶总面积M2=屋顶总面积m2_3, 单位面积用瓦数=value_list_3)
multiplication_14 = Multiplication(屋顶总面积M2=屋顶总面积m2_6)
multiplication_15 = Multiplication(B=M, C=M_2)
multiplication_16 = Multiplication(B=M_3, C=M_4)
multiplication_17 = Multiplication(木梁长度=division_8, 木梁截面积M2=木梁截面积_m2_2)
保温层体积 = Panel(multiplication_9)
岩棉板密度_kg_m³ = Panel("120")
碳排放系数kg_co2e_t = Panel("1980")
梁体积_m3 = Panel(multiplication_8)
低密度聚乙烯碳排放系数 = Panel("2810")
integer = Integer(multiplication_12)
聚氯乙烯密度 = Panel("930")
聚氯乙烯体积 = Panel(multiplication_11)
木材密度 = Panel("400")
integer_2 = Integer(multiplication_10)
integer_3 = Integer(multiplication_13)
顺水条_m = Panel(integer)
挂瓦条_m = Panel(integer_2)
木材密度_2 = Panel("400")
木材密度_3 = Panel("400")
顺水条截面积 = Panel(multiplication_15)
梁体积_m3_2 = Panel(multiplication_17)
瓦片重量系数 = ValueList({"平板瓦": 5, "卢卡瓦": 5, "天筒瓦": 5, "罗曼瓦": 5}, selected="平板瓦")
挂瓦条截面积 = Panel(multiplication_16)
木材密度_4 = Panel("400")
瓦数量_个 = Panel(integer_3)
multiplication_18 = Multiplication(防水卷材体积=聚氯乙烯体积, 聚氯乙烯密度=聚氯乙烯密度, 低密度聚乙烯碳排放系数=低密度聚乙烯碳排放系数, 千克转化系数=Slider(0.001, range=0..0.001))
multiplication_19 = Multiplication(保温层体积=保温层体积, 岩棉板密度KgM³=岩棉板密度_kg_m³, 碳排放系数kgCO2eT=碳排放系数kg_co2e_t, 千克转化系数=Slider(0.001, range=0..0.001))
multiplication_20 = Multiplication(保温层体积=保温层体积, 岩棉板密度KgM³=岩棉板密度_kg_m³)
multiplication_21 = Multiplication(防水卷材体积=聚氯乙烯体积, 聚氯乙烯密度=聚氯乙烯密度)
multiplication_22 = Multiplication(梁体积M3=梁体积_m3, 木材容重=木材密度)
multiplication_23 = Multiplication(顺水条长度=顺水条_m, 木材容重=木材密度_3, 顺水条截面积=顺水条截面积)
multiplication_24 = Multiplication(挂瓦条长度=挂瓦条_m, 挂瓦条截面积=挂瓦条截面积, 木材容重=木材密度_4)
multiplication_25 = Multiplication(梁体积M3=梁体积_m3_2, 木材容重=木材密度_2)
multiplication_26 = Multiplication(屋顶总面积M2=瓦数量_个, 每个瓦重量=瓦片重量系数)
瓦片总重 = Panel(multiplication_26)
挂瓦条重量kg = Panel(multiplication_24)
cluster_6 = Cluster_8()
cluster_7 = Cluster_8()
cluster_8 = Cluster_8()
cluster_9 = Cluster_7()
cluster_10 = Cluster_8()
顺水条重量kg = Panel(multiplication_23)
_1kg木材碳排放 = Panel(cluster_6)
_1kg木材碳排放_2 = Panel(cluster_8)
_1kg木材碳排放_3 = Panel(cluster_10)
_1kg木材碳排放_4 = Panel(cluster_7)
消耗标注煤系数kg_t = Panel("43")
标准煤排放co2系数 = Panel(cluster_9)
multiplication_27 = Multiplication(瓦片重量=瓦片总重, 千克转化系数=Slider(0.001, range=0..0.001))
multiplication_28 = Multiplication(顺水条重量kg=顺水条重量kg, _1KG木材碳排放=_1kg木材碳排放)
multiplication_29 = Multiplication(A=multiplication_22, B=_1kg木材碳排放_2)
multiplication_30 = Multiplication(A=multiplication_25, B=_1kg木材碳排放_3)
multiplication_31 = Multiplication(挂瓦条重量kg=挂瓦条重量kg, 木材碳排放系数=_1kg木材碳排放_4)
multiplication_32 = Multiplication(多少吨瓦片=multiplication_27, 烧制一吨瓦片消耗的标准煤=消耗标注煤系数kg_t, 标准煤碳排放系数=标准煤排放co2系数)
屋顶保温板碳排放量kg = Panel(multiplication_19)
面宽梁碳排放kg = Panel(multiplication_29)
进深梁碳排放kg = Panel(multiplication_30)
防水层碳排放量kg = Panel(multiplication_18)
挂瓦条碳排放量kg = Panel(multiplication_31)
顺水条碳排放量kg = Panel(multiplication_28)
integer_4 = Integer(multiplication_32)

addition = Addition(瓦片使用量KG=瓦片总重)
addition_2 = Addition(挂瓦条重量=挂瓦条重量kg, 顺水条重量=顺水条重量kg, 梁重量=multiplication_22, 梁重量_2=multiplication_25)
木材使用量kg = Panel(addition_2)
瓦片使用量kg = Panel(addition)

# ----
# 人工碳排放
# 一个建筑工日8小时消耗能量1175大
天数 = Slider(10, range=0..10)
人数 = Slider(25, range=0..100)
mj = Panel("4.92")
multiplication_33 = Multiplication(A=人数, B=mj, C=天数)
生物碳排放系数 = Panel("0.001")
mj_2 = Panel(multiplication_33)
multiplication_34 = Multiplication(A=mj_2, B=生物碳排放系数)
tj = Panel(multiplication_34)
division_9 = Division(A=tj, B=Slider(27.3, range=0..100))
生物质碳排放系数 = Panel("117")
panel_24 = Panel(division_9)
multiplication_35 = Multiplication(A=panel_24, B=生物质碳排放系数)
number_slider_4 = Slider(1000, range=0..1000)
二氧化碳t = Panel(multiplication_35)
multiplication_36 = Multiplication(A=二氧化碳t, B=number_slider_4)
人工二氧化碳kg = Panel(multiplication_36)

# ----
# 建筑建造能耗
# 地基工程
facesbytype_5 = HBFacesByType(hb_objs=rotate)  # -> walls, interior_walls, roofs, ceilings, exterior_floors, interior_floors, air_walls, apertures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; plug-in component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
vizall_7 = HBVisualizeAll(hb_objs=flatten(facesbytype_5.exterior_floors))  # -> geo; plug-in component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
area_3 = Area(Geometry=vizall_7)  # -> Area, Centroid
下挖距离 = Slider(0.6, range=0..10)
mass_addition_3 = MassAddition(Input=area_3.Area)  # -> Result, PartialResults
multiplication_37 = Multiplication(A=mass_addition_3.Result, B=下挖距离)
日立200台班工作量 = Panel("360")
土方面积体积 = Panel(multiplication_37)
division_10 = Division(A=土方面积体积, B=日立200台班工作量)
台班数 = Panel(division_10)
台班耗油量 = Panel("63")
柴油碳排放系数 = Panel("72.59")
multiplication_38 = Multiplication(A=台班数, B=台班耗油量, C=柴油碳排放系数)
土方工程碳排放量kg = Panel(multiplication_38)
addition_3 = Addition(A=土方工程碳排放量kg, B=人工二氧化碳kg)
建筑建造碳排放kg = Panel(addition_3)

vizall_8 = HBVisualizeAll(hb_objs=flatten(facesbytype_4.outdoor_shades))  # -> geo; plug-in component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
multiplication_39 = Multiplication(A=木材使用量kg, B=number_slider_3)
# 建筑拆除能耗
number_slider_5 = Slider(0.1, range=0..0.1)
木材回收kg = Panel(multiplication_39)
multiplication_40 = Multiplication(A=建筑建造碳排放kg, B=number_slider_5)

每平米钢筋用量0_3kg = Panel("30")
multiplication_41 = Multiplication(A=房间面宽, B=房间进深抽取值)
multiplication_42 = Multiplication(A=multiplication_41, B=每平米钢筋用量0_3kg, C=Slider(0.001, range=0..0.001))
multiplication_43 = Multiplication(低碳热轧盘条高线HPB300Φ6Φ65每吨=multiplication_42, B="5324")
钢筋造价 = Panel(multiplication_43)

cluster_11 = Cluster_8()
_1kg木材碳排放_5 = Panel(cluster_11)

瓦片容重 = Slider(2000, range=0..10000)
division_11 = Division(A=瓦片使用量kg, B=瓦片容重)
multiplication_44 = Multiplication(瓦片体积=division_11, 单位立方米瓦片价格="360")
瓦片造价 = Panel(multiplication_44)

建筑拆除碳排放 = Panel(multiplication_40)

木材密度_5 = Panel("400")
division_12 = Division(A=木材使用量kg, B=木材密度_5)
multiplication_45 = Multiplication(松木板材各种规格m3=division_12, B="1700")
木材 = Panel(multiplication_45)

multiplication_46 = Multiplication(A=木材回收kg, B=_1kg木材碳排放_5)
木材回收碳排放kg = Panel(multiplication_46)
negative = Negative(Value=木材回收碳排放kg)
瓦数量_个_2 = Panel(integer_3)
生产瓦碳排放量kg = Panel(integer_4)
addition_4 = Addition(
    生产瓦碳排放量kg=生产瓦碳排放量kg,
    挂瓦条碳排放量kg=挂瓦条碳排放量kg,
    顺水条碳排放量kg=顺水条碳排放量kg,
    防水层碳排放量kg=防水层碳排放量kg,
    屋顶保温板碳排放量kg=屋顶保温板碳排放量kg,
    面宽梁碳排放kg=面宽梁碳排放kg,
    进深梁碳排放kg=进深梁碳排放kg)
division_13 = Division(A=生产瓦碳排放量kg, B=瓦数量_个_2)
integer_5 = Integer(addition_4)
panel_25 = Panel(division_13)
cluster_12 = Cluster_6(list=vizall_5)

multiplication_47 = Multiplication(A=房间面宽, B=房间进深抽取值)
# 钢筋
每平米钢筋用量0_3kg_2 = Panel("30")
multiplication_48 = Multiplication(A=multiplication_47, B=每平米钢筋用量0_3kg_2, C=Slider(0.001, range=0..0.001))
multiplication_49 = Multiplication(A=multiplication_48, B="1.06", C=Slider(1000, range=0..1000))
kg_2 = Panel(multiplication_49)

屋顶材料碳排放量kg = Panel(integer_5)
墙体总面积m2 = Panel(cluster_12)

# ----
# 保温层
number_slider_6 = Slider(0.001, range=0..0.001)
岩棉板碳排放系数kg_co2e_t = Panel("1980")
岩棉板容重_kg_m³ = Panel("120")
multiplication_50 = Multiplication(墙体总面积=墙体总面积m2, 岩棉板厚度=multiplication_3, 岩棉板容重=岩棉板容重_kg_m³, 岩棉板碳排放系数kgCO2eT=岩棉板碳排放系数kg_co2e_t, 千克转换系数=number_slider_6)

# ----
# 找平层
number_slider_7 = Slider(0.001, range=0..0.001)
c30混凝土厚度 = Slider(0.1, range=0..1)
c30密度_kg_m³ = Panel("1300")
碳排放系数kg_co2e_t_2 = Panel("295")
multiplication_51 = Multiplication(墙体总面积=墙体总面积m2, C30混凝土厚度=c30混凝土厚度, C30密度KgM³=c30密度_kg_m³, 混凝土碳排放系数kgCO2eT=碳排放系数kg_co2e_t_2, 千克转换系数=number_slider_7)

砌块厚度 = Slider(0.048, range=0..0.1)
multiplication_52 = Multiplication(墙体总面积M2=墙体总面积m2, 砌块厚度=砌块厚度, 砌块容重=砌块容重)
砌块重量kg = Panel(multiplication_52)
multiplication_53 = Multiplication(A=砌块重量kg, B=Slider(0.55, range=0..1))
砌块回收kg = Panel(multiplication_53)

multiplication_54 = Multiplication(墙体总面积M2=墙体总面积m2, 砌块厚度=砌块厚度)
multiplication_55 = Multiplication(纯陶粒空心砌块M3=multiplication_54, B="230")
砌块造价 = Panel(multiplication_55)

# ----
# 抹灰层
number_slider_8 = Slider(0.001, range=0..0.001)
kgco2_e_t = Panel("735")
# 工程材料造价
厚度 = Slider(0.01, range=0..1)
multiplication_56 = Multiplication(墙体总面积=墙体总面积m2, 抹灰层厚度=厚度, 抹灰碳排放系数=kgco2_e_t, 水泥砂浆容重="2000", 千克转换系数=number_slider_8)

# ----
# 砌块层
number_slider_9 = Slider(0.001, range=0..0.001)
kg_co2e_m3 = Panel("204")
multiplication_57 = Multiplication(墙体总面积=墙体总面积m2, 砌块厚度=砌块厚度, 砌块碳排放系数=kg_co2e_m3, 千克转换系数=number_slider_9)

data_recorder = DataRecorder(kg, DataLimit=-10, RecordData=True)
multiplication_58 = Multiplication(墙体总面积=墙体总面积m2, 岩棉板厚度=multiplication_3, 岩棉板容重=岩棉板容重_kg_m³)
multiplication_59 = Multiplication(墙体总面积=墙体总面积m2, C30混凝土厚度=c30混凝土厚度, C30密度KgM³=c30密度_kg_m³)

vizall_9 = HBVisualizeAll(hb_objs=flatten(facesbytype_4.doors))  # -> geo; plug-in component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
vizall_10 = HBVisualizeAll(hb_objs=flatten(facesbytype_4.exterior_floors))  # -> geo; plug-in component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
vizall_11 = HBVisualizeAll(hb_objs=flatten(facesbytype_4.apertures))  # -> geo; plug-in component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
area_4 = Area(Geometry=vizall_11)  # -> Area, Centroid
area_5 = Area(Geometry=vizall_9)  # -> Area, Centroid
area_6 = Area(Geometry=vizall_10)  # -> Area, Centroid
mass_addition_4 = MassAddition(Input=area_4.Area)  # -> Result, PartialResults
mass_addition_5 = MassAddition(Input=area_6.Area)  # -> Result, PartialResults
mass_addition_6 = MassAddition(Input=area_5.Area)  # -> Result, PartialResults
楼底层总面积m2 = Panel(mass_addition_5.Result)
_150_厚混凝土底板层 = Panel("0.15")
value_list_6 = ValueList({"防水层厚度": 0.004}, selected="防水层厚度")
楼底层总面积m2_2 = Panel(mass_addition_5.Result)
楼底层保温板厚度 = Panel(multiplication_3)
楼底层总面积m2_3 = Panel(mass_addition_5.Result)
_20厚 = Slider(0.02, range=0..0.1)
塑钢窗每平米碳排放 = Panel("129.5")
窗户总面积m2 = Panel(mass_addition_4.Result)
门总面积m2 = Panel(mass_addition_6.Result)
塑钢窗每平米碳排放_2 = Panel("129.5")
楼底层总面积m2_4 = Panel(mass_addition_5.Result)
multiplication_60 = Multiplication(楼底层总面积M2=楼底层总面积m2, _150厚混凝土底板层=_150_厚混凝土底板层)
multiplication_61 = Multiplication(楼底层总面积M2=楼底层总面积m2_2, 防水层厚度=value_list_6)
multiplication_62 = Multiplication(楼底层总面积M2=楼底层总面积m2_3, 楼底层保温板厚度=楼底层保温板厚度)
multiplication_63 = Multiplication(楼底层岩棉板碳排放=楼底层总面积m2_4, 水泥砂浆厚度=_20厚)
multiplication_64 = Multiplication(窗户总面积M2=窗户总面积m2, 塑钢窗每平米碳排放=塑钢窗每平米碳排放)
multiplication_65 = Multiplication(门总面积M2=门总面积m2, 塑钢窗每平米碳排放=塑钢窗每平米碳排放_2)
千克转化系数 = Slider(0.001, range=0..0.001)
水泥容重 = Slider(1300, range=0..10000)
低密度聚乙烯碳排放系数_2 = Panel("2810")
聚氯乙烯密度_2 = Panel("930")
聚氯乙烯体积_2 = Panel(multiplication_61)
碳排放系数kg_co2e_t_3 = Panel("1980")
保温层体积_2 = Panel(multiplication_62)
岩棉板密度_kg_m³_2 = Panel("120")
c30碳排放系数kg_co2e_m2 = Panel("295")
_150_厚混凝土底板层体积 = Panel(multiplication_60)
水泥砂浆层体积 = Panel(multiplication_63)
multiplication_66 = Multiplication(A=聚氯乙烯体积_2, B=聚氯乙烯密度_2, C=低密度聚乙烯碳排放系数_2, D=Slider(0.001, range=0..0.001))
multiplication_67 = Multiplication(聚氯乙烯体积=聚氯乙烯体积_2, 聚氯乙烯密度=聚氯乙烯密度_2)
multiplication_68 = Multiplication(保温层体积=保温层体积_2, 岩棉板密度=岩棉板密度_kg_m³_2, 岩棉板密度_2=碳排放系数kg_co2e_t_3, 千克转化系数=千克转化系数)
multiplication_69 = Multiplication(保温层体积=保温层体积_2, 岩棉板容重=岩棉板密度_kg_m³_2)
multiplication_70 = Multiplication(_150厚混凝土底板层体积=_150_厚混凝土底板层体积, C30碳排放系数kgCO2eM2=c30碳排放系数kg_co2e_m2)
multiplication_71 = Multiplication(_150厚混凝土底板层体积=_150_厚混凝土底板层体积, 水泥容重=水泥容重)
水泥砂浆密度 = Panel("2000")
kgco2_e_t_2 = Panel("735")
multiplication_72 = Multiplication(水泥砂浆层体积=水泥砂浆层体积, 水泥砂浆密度=水泥砂浆密度)
addition_5 = Addition(楼地层C30使用量=multiplication_71, 墙体C30使用量=multiplication_59)
层数 = Slider(2, range=0..10)
multiplication_73 = Multiplication(A=水泥砂浆层体积, B=kgco2_e_t_2, C=水泥砂浆密度, D="0.001")
防水层碳排放量kg_2 = Panel(multiplication_66)
multiplication_74 = Multiplication(一层防水层碳排放量kg=flatten(防水层碳排放量kg_2), _2层=层数)
水泥砂浆碳排放kg = Panel(multiplication_73)
楼底层岩棉板碳排放量kg = Panel(multiplication_68)
_150_厚混凝土底板层kg = Panel(multiplication_70)
门碳排放kg = Panel(multiplication_65)
塑钢窗碳排放kg = Panel(multiplication_64)
addition_6 = Addition(楼地层水泥砂浆碳排放KG=水泥砂浆碳排放kg, 楼地层防水层碳排放=multiplication_74, 楼地层岩棉板碳排放量kg=楼底层岩棉板碳排放量kg, 楼地层混凝土底板层C30碳排放KG=_150_厚混凝土底板层kg)

addition_7 = Addition(屋顶防水卷材的重量=multiplication_21, 楼地层防水层重量=multiplication_67)
addition_8 = Addition(屋顶岩棉板重量=multiplication_20, 楼底层岩棉板重量=multiplication_69, 墙体岩棉板重量=multiplication_58)
塑钢窗平米数 = Panel(窗户总面积m2)
保温层使用量kg = Panel(addition_8)
c30使用量kg = Panel(addition_5)
门平米数 = Panel(门总面积m2)
防水层聚乙烯sbs使用量 = Panel(addition_7)
multiplication_75 = Multiplication(A=c30使用量kg, B=Slider(0.55, range=0..1))
混凝土回收kg = Panel(multiplication_75)

c30容重 = Slider(1300, range=0..10000)
division_14 = Division(C30重量=c30使用量kg, B=c30容重)
multiplication_76 = Multiplication(C30=division_14, 按立方米收费="355")
c30土建造价元 = Panel(multiplication_76)

聚氯乙烯密度_3 = Panel("930")
聚氯乙烯厚度 = Panel("0.004")
division_15 = Division(A=防水层聚乙烯sbs使用量, B=聚氯乙烯密度_3)
division_16 = Division(A=division_15, B=聚氯乙烯厚度)
每平方米造价 = Panel("30")
multiplication_77 = Multiplication(SBS改性防水卷材国标聚脂胎354mm平方米数=division_16, B=每平方米造价)
防水层造价 = Panel(multiplication_77)

岩棉板密度_kg_m³_3 = Panel("120")
division_17 = Division(A=保温层使用量kg, B=岩棉板密度_kg_m³_3)
multiplication_78 = Multiplication(岩棉板体积=division_17, 单位立方米岩棉板价格="500")
岩棉板造价 = Panel(multiplication_78)

multiplication_79 = Multiplication(白色65单框双玻塑钢平开窗中空不含安装费=塑钢窗平米数, 按立方米收费="265")
白色65单框双玻塑钢平开窗_中空_不含安装费 = Panel(multiplication_79)

楼底层碳排放kg = Panel(addition_6)
multiplication_80 = Multiplication(墙体总面积=墙体总面积m2, 抹灰层厚度=厚度, 水泥砂浆容重="2000")
addition_9 = Addition(楼地层水泥砂浆重量=multiplication_72, 墙体水泥砂浆重量=multiplication_80)
水泥砂浆重量kg = Panel(addition_9)

水泥砂浆密度_2 = Panel("2000")
division_18 = Division(A=水泥砂浆重量kg, B=水泥砂浆密度_2)
multiplication_81 = Multiplication(A=division_18, B=Slider(0.7, range=0..1))

水泥砂浆密度_3 = Panel("2000")
硅酸盐水泥容重 = Slider(2000, range=0..10000)
division_19 = Division(A=水泥砂浆重量kg, B=水泥砂浆密度_3)
multiplication_82 = Multiplication(A=division_19, B=Slider(0.3, range=0..1), C=硅酸盐水泥容重)

每吨560元 = Panel("560.000")
multiplication_83 = Multiplication(普通硅酸盐水泥R525=multiplication_82, _560000=每吨560元, 千克转化系数=Slider(0.001, range=0..0.001))
硅酸盐水泥土建造价元 = Panel(multiplication_83)

multiplication_84 = Multiplication(预拌干混砌筑砂浆DMM50=multiplication_81, B="376")
沙子造价 = Panel(multiplication_84)

addition_10 = Addition(A=硅酸盐水泥土建造价元, B=c30土建造价元, C=白色65单框双玻塑钢平开窗_中空_不含安装费, D=岩棉板造价, E=瓦片造价, F=防水层造价, G=木材, H=砌块造价, I=沙子造价, J=钢筋造价)

# ----
# 建筑材料运输能耗
addition_11 = Addition(
    保温层使用量KG=保温层使用量kg,
    C30使用量KG=c30使用量kg,
    木材使用量kg=木材使用量kg,
    瓦片使用量KG=砌块重量kg,
    防水层聚乙烯SBS使用量KG=瓦片使用量kg,
    水泥砂浆重量KG=防水层聚乙烯sbs使用量,
    砌块重量KG=水泥砂浆重量kg)
载重十吨运输系数 = Panel("0.162")
运输距离 = Panel("500")
integer_6 = Integer(addition_11)
multiplication_85 = Multiplication(A=integer_6, B=载重十吨运输系数, C=运输距离, D=Slider(0.001, range=0..0.001))
材料运输的碳排放量kg = Panel(multiplication_85)

panel_26 = Panel(data_recorder)
addition_12 = Addition(岩棉板材料碳排放=multiplication_50, C20材料碳排放=multiplication_51, 砌块碳排放=multiplication_57, 抹灰水泥砂浆碳排放=multiplication_56, 钢材碳排放=kg_2)
integer_7 = Integer(addition_12)
墙体材料碳排放量kg = Panel(integer_7)
addition_13 = Addition(墙体材料碳排放量kg=墙体材料碳排放量kg, B=屋顶材料碳排放量kg, C=塑钢窗碳排放kg, D=门碳排放kg, E=楼底层碳排放kg)
建筑材料碳排放kg = Panel(addition_13)
addition_14 = Addition(建筑拆除碳排放=建筑拆除碳排放, 建筑回收碳排放=negative, 建筑材料运输碳排放=材料运输的碳排放量kg, 建筑材料生产碳排放=建筑材料碳排放kg, 建筑建造碳排放=建筑建造碳排放kg, 建筑运行碳排放=kg)
总碳排放kgmax = Panel("195003.241276")
total_carbon_emissions = Panel(addition_14)
工程材料造价max = Panel("348750.303231")
engineering_material_cost = Panel(addition_10)
building_interior_thermal_comfort = Panel(division_5)
division_20 = Division(A=工程材料造价max, B=engineering_material_cost)
division_21 = Division(A=总碳排放kgmax, B=total_carbon_emissions)
工程造价百分比 = Panel(division_20)
碳排放百分比 = Panel(division_21)
multiplication_86 = Multiplication(A=碳排放百分比, B="0.3407")
multiplication_87 = Multiplication(A=工程造价百分比, B="0.2195")
multiplication_88 = Multiplication(A=building_interior_thermal_comfort, B="0.4399")
panel_27 = Panel(multiplication_86)
panel_28 = Panel(multiplication_87)
panel_29 = Panel(multiplication_88)
addition_15 = Addition(A=panel_28, B=panel_29, C=panel_27)
composite_index_k = Panel(addition_15)
colibri_parameters = ColibriParameters(
    Engineering_material_cost=flatten(engineering_material_cost),
    Building_interior_thermal_comfort=flatten(building_interior_thermal_comfort),
    Total_carbon_emissions=flatten(total_carbon_emissions),
    Composite_Index_K=flatten(composite_index_k),
    Room_depth_sampling=flatten(room_depth_sampling),
    Roof_slope_sample_value=flatten(roof_slope_sample_value),
    Building_orientation_sampling=flatten(building_orientation_sampling),
    Building_height_sampling=flatten(building_height_sampling),
    Insulation_layer_thickness_sampling=flatten(insulation_layer_thickness_sampling),
    Sampling_value_of_front_porch_width=flatten(sampling_value_of_front_porch_width),
    South_facing_window_opening_ratio=flatten(south_facing_window_opening_ratio),
    Minimum_heating_temperature_value=flatten(minimum_heating_temperature_value),
    Maximum_refrigeration_temperature=flatten(maximum_refrigeration_temperature))
colibri_aggregator = ColibriAggregator(
    Folder="C:\600",
    IterationGenomeID=colibri_iterator.IterationGenome,
    IterationPhenomeResults=colibri_parameters,
    ImgSetting=image_setting,
    _3DObjects=flatten(spectacles_colibri_3dobjects),
    Write=Toggle(False),
    recordingMode=3)
data_recorder_2 = DataRecorder(composite_index_k, DataLimit=-10, RecordData=True)
panel_30 = Panel(data_recorder_2)

# ==== cluster Cluster
hb_objs = ClusterInput()
vizall = HBVisualizeAll(hb_objs=flatten(hb_objs))  # -> geo; plug-in component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
degrees = ClusterInput()
degrees_2 = ClusterInput()
radians = Radians(Degrees=degrees)
radians_2 = Radians(Degrees=degrees_2)
negative = Negative(Value=radians)
negative_2 = Negative(Value=radians_2)
deconstruct_brep = DeconstructBrep(Brep=vizall)  # -> Faces, Edges, Vertices
deconstruct_brep_2 = DeconstructBrep(Brep=vizall)  # -> Faces, Edges, Vertices
unit_x = UnitX(Factor=1)
unit_x_2 = UnitX(Factor=1)
list_item = ListItem(List=deconstruct_brep.Edges, Index=Slider(0, range=0..10), Wrap=True)
list_item_2 = ListItem(List=deconstruct_brep.Vertices, Index=Slider(1, range=0..1), Wrap=True)
list_item_3 = ListItem(List=deconstruct_brep_2.Edges, Index=Slider(6, range=0..10), Wrap=True)
list_item_4 = ListItem(List=deconstruct_brep_2.Vertices, Index=Slider(7, range=0..10), Wrap=True)
list_item_5 = ListItem(List=deconstruct_brep.Edges, Index=0, Wrap=True)
list_item_6 = ListItem(List=deconstruct_brep.Vertices, Index=0, Wrap=True)
list_item_7 = ListItem(List=deconstruct_brep_2.Edges, Index=Slider(6, range=0..10), Wrap=True)
list_item_8 = ListItem(List=deconstruct_brep_2.Vertices, Index=Slider(10, range=0..10), Wrap=True)
reverse = Reverse(Vector=unit_x)
rotate_3d = Rotate3D(Geometry=list_item_5, Angle=radians, Center=list_item_6, Axis=reverse)  # -> Geometry, Transform
rotate_3d_2 = Rotate3D(Geometry=list_item, Angle=negative, Center=list_item_2, Axis=reverse)  # -> Geometry, Transform
rotate_3d_3 = Rotate3D(Geometry=list_item_7, Angle=radians_2, Center=list_item_8, Axis=unit_x_2)  # -> Geometry, Transform
rotate_3d_4 = Rotate3D(Geometry=list_item_3, Angle=negative_2, Center=list_item_4, Axis=unit_x_2)  # -> Geometry, Transform

list_item_9 = ListItem(List=deconstruct_brep.Edges, Index=Slider(3, range=0..10), Wrap=True)
list_item_10 = ListItem(List=deconstruct_brep.Edges, Index=Slider(5, range=0..10), Wrap=True)

curve_curve = CurveCurve(CurveA=rotate_3d.Geometry, CurveB=rotate_3d_2.Geometry)  # -> Points, ParamsA, ParamsB
curve_curve_2 = CurveCurve(CurveA=rotate_3d_3.Geometry, CurveB=rotate_3d_4.Geometry)  # -> Points, ParamsA, ParamsB
points = ClusterOutput(curve_curve.Points)
points_2 = ClusterOutput(curve_curve_2.Points)
line = Line(StartPoint=curve_curve.Points, EndPoint=curve_curve_2.Points)
line_2 = Line(StartPoint=curve_curve_2.Points, EndPoint=curve_curve.Points)
ruled_surface = RuledSurface(CurveA=list_item_9, CurveB=line_2)
ruled_surface_2 = RuledSurface(CurveA=list_item_10, CurveB=line)
surface = ClusterOutput(ruled_surface)
surface_2 = ClusterOutput(ruled_surface_2)

# ==== cluster Cluster_2
门高 = Slider(2.2, range=-10..10)
门宽 = Slider(1, range=0..1)
brep = ClusterInput()
deconstruct_brep = DeconstructBrep(Brep=brep)  # -> Faces, Edges, Vertices
A = ClusterInput()
subtraction = Subtraction(A=A, B=门宽)
A_2 = ClusterInput()
subtraction_2 = Subtraction(A=A_2, B=门高, C=Slider(0.1, range=0..0.1))
division = Division(A=subtraction, B=Slider(2, range=0..10))
unit_z = UnitZ(Factor=subtraction_2)
unit_x = UnitX(Factor=division)
list_item = ListItem(List=deconstruct_brep.Faces, Index=Slider(0, range=0..10), Wrap=True)
reverse = Reverse(Vector=unit_x)
reverse_2 = Reverse(Vector=unit_z)
plane_surface = PlaneSurface(Plane=list_item, XSize=门高, YSize=门宽)
move = Move(Geometry=plane_surface, Motion=reverse_2)  # -> Geometry, Transform
move_2 = Move(Geometry=move.Geometry, Motion=reverse)  # -> Geometry, Transform
door = HBDoor(geo=move_2.Geometry, name="DOOR_1")  # -> out, doors; plug-in component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
doors = ClusterOutput(door.doors)

# ==== cluster Cluster_3
panel = Panel("https://energyplus-weather.s3.amazonaws.com/asia_wmo_region_2/CHN/CHN_Kinjiang.Uygur.Yining.514310_SWERA/CHN_Kinjiang.Uygur.Yining.514310_SWERA.zip")
downloadepw = LBDownloadWeather(weather_URL=panel)  # -> epw_file, stat_file, ddy_file; plug-in component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
epw_file = ClusterOutput(downloadepw.epw_file)

# ==== cluster Cluster_4

boolean_toggle = BooleanToggle(True)
value_list = ValueList({"Annual", "Monthly", "Daily", "Hourly", "Timestep"}, selected="Hourly")
simoutput = HBSimulationOutput(
    zone_energy_use=boolean_toggle,
    hvac_energy_use=boolean_toggle,
    gains_and_losses=boolean_toggle,
    comfort_metrics=boolean_toggle,
    surface_temperature=boolean_toggle,
    surface_energy_flow=boolean_toggle,
    report_frequency=value_list)  # -> out, sim_output; plug-in component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
customoutput = HBCustomSimulationOutput(base_sim_output=simoutput.sim_output)  # -> out, sim_output; plug-in component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
simpar = HBSimulationParameter(output=customoutput.sim_output, timestep=6)  # -> sim_par; plug-in component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

sim_par = ClusterOutput(simpar)

# ==== cluster Cluster_5
brep = ClusterInput()
factor = ClusterInput()
factor_2 = ClusterInput()

number_slider = Slider(0.2, range=0..1)
negative = Negative(Value=number_slider)
unit_x = UnitX(Factor=negative)

number_slider_2 = Slider(0.2, range=0..1)
division = Division(A=number_slider_2, B=Slider(2, range=0..10))
negative_2 = Negative(Value=division)
unit_x_2 = UnitX(Factor=negative_2)

number_slider_3 = Slider(0.2, range=0..1)
division_2 = Division(A=number_slider_3, B=Slider(2, range=0..10))
negative_3 = Negative(Value=division_2)
unit_x_3 = UnitX(Factor=negative_3)

number_slider_4 = Slider(0.2, range=0..1)
plane_surface = PlaneSurface(Plane=PlaneXY(0, 0, 0), XSize=number_slider_4, YSize=number_slider_4)

number_slider_5 = Slider(4, range=0..10)
deconstruct_brep = DeconstructBrep(Brep=brep)  # -> Faces, Edges, Vertices
list_item = ListItem(List=deconstruct_brep.Edges, Index=number_slider_5, Wrap=True)
unit_y = UnitY(Factor=factor)
reverse = Reverse(Vector=unit_y)
move = Move(Geometry=list_item, Motion=reverse)  # -> Geometry, Transform
unit_y_2 = UnitY(Factor=factor_2)
reverse_2 = Reverse(Vector=unit_y_2)
ruled_surface = RuledSurface(CurveA=move.Geometry, CurveB=list_item)

list_item_2 = ListItem(List=deconstruct_brep.Edges, Index=number_slider_5, Wrap=True)
list_item_3 = ListItem(List=deconstruct_brep.Edges, Index=Slider(0, range=0..10), Wrap=True)
divide_curve = DivideCurve(Curve=list_item_3, Count=Slider(3, range=0..10), Kinks=False)  # -> Points, Tangents, Parameters
divide_curve_2 = DivideCurve(Curve=list_item_2, Count=Slider(3, range=0..10), Kinks=False)  # -> Points, Tangents, Parameters
list_item_4 = ListItem(List=divide_curve.Points, Index=Slider(3, range=0..3), Wrap=True)
list_item_5 = ListItem(List=divide_curve_2.Points, Index=Slider(0, range=0..3), Wrap=True)
xy_plane = XYPlane(Origin=list_item_4)
line = Line(StartPoint=list_item_4, EndPoint=list_item_5)
move_2 = Move(Geometry=xy_plane, Motion=unit_x)  # -> Geometry, Transform
plane_surface_2 = PlaneSurface(Plane=move_2.Geometry, XSize=number_slider, YSize=number_slider)
extrude = Extrude(Base=plane_surface_2, Direction=line)

list_item_6 = ListItem(List=deconstruct_brep.Edges, Index=number_slider_5, Wrap=True)
list_item_7 = ListItem(List=deconstruct_brep.Edges, Index=Slider(0, range=0..10), Wrap=True)
divide_curve_3 = DivideCurve(Curve=list_item_7, Count=Slider(3, range=0..10), Kinks=False)  # -> Points, Tangents, Parameters
divide_curve_4 = DivideCurve(Curve=list_item_6, Count=Slider(3, range=0..10), Kinks=False)  # -> Points, Tangents, Parameters
list_item_8 = ListItem(List=divide_curve_3.Points, Index=Slider(2, range=0..3), Wrap=True)
list_item_9 = ListItem(List=divide_curve_4.Points, Index=Slider(1, range=0..3), Wrap=True)
xy_plane_2 = XYPlane(Origin=list_item_8)
line_2 = Line(StartPoint=list_item_8, EndPoint=list_item_9)
move_3 = Move(Geometry=xy_plane_2, Motion=unit_x_2)  # -> Geometry, Transform
plane_surface_3 = PlaneSurface(Plane=move_3.Geometry, XSize=number_slider_2, YSize=number_slider_2)
extrude_2 = Extrude(Base=plane_surface_3, Direction=line_2)

list_item_10 = ListItem(List=deconstruct_brep.Edges, Index=number_slider_5, Wrap=True)
list_item_11 = ListItem(List=deconstruct_brep.Edges, Index=Slider(0, range=0..10), Wrap=True)
divide_curve_5 = DivideCurve(Curve=list_item_11, Count=Slider(3, range=0..10), Kinks=False)  # -> Points, Tangents, Parameters
divide_curve_6 = DivideCurve(Curve=list_item_10, Count=Slider(3, range=0..10), Kinks=False)  # -> Points, Tangents, Parameters
list_item_12 = ListItem(List=divide_curve_5.Points, Index=Slider(1, range=0..3), Wrap=True)
list_item_13 = ListItem(List=divide_curve_6.Points, Index=Slider(2, range=0..3), Wrap=True)
xy_plane_3 = XYPlane(Origin=list_item_12)
line_3 = Line(StartPoint=list_item_12, EndPoint=list_item_13)
move_4 = Move(Geometry=xy_plane_3, Motion=unit_x_3)  # -> Geometry, Transform
plane_surface_4 = PlaneSurface(Plane=move_4.Geometry, XSize=number_slider_3, YSize=number_slider_3)
extrude_3 = Extrude(Base=plane_surface_4, Direction=line_3)

list_item_14 = ListItem(List=deconstruct_brep.Edges, Index=number_slider_5, Wrap=True)
list_item_15 = ListItem(List=deconstruct_brep.Edges, Index=Slider(0, range=0..10), Wrap=True)
divide_curve_7 = DivideCurve(Curve=list_item_15, Count=Slider(3, range=0..10), Kinks=False)  # -> Points, Tangents, Parameters
divide_curve_8 = DivideCurve(Curve=list_item_14, Count=Slider(3, range=0..10), Kinks=False)  # -> Points, Tangents, Parameters
list_item_16 = ListItem(List=divide_curve_7.Points, Index=Slider(0, range=0..3), Wrap=True)
list_item_17 = ListItem(List=divide_curve_8.Points, Index=Slider(3, range=0..3), Wrap=True)
xy_plane_4 = XYPlane(Origin=list_item_16)
line_4 = Line(StartPoint=list_item_16, EndPoint=list_item_17)
extrude_4 = Extrude(Base=plane_surface, Direction=line_4)

move_5 = Move(Geometry=[extrude, extrude_2, extrude_3, extrude_4], Motion=reverse_2)  # -> Geometry, Transform

surface = ClusterOutput(ruled_surface)
geometry = ClusterOutput(move_5.Geometry)

# ==== cluster Cluster_6
list = ClusterInput()
list_item = ListItem(List=list, Index=["0", "4", "5", "6", "7", "8"], Wrap=True)
area = Area(Geometry=list_item)  # -> Area, Centroid
mass_addition = MassAddition(Input=area.Area)  # -> Result, PartialResults
result = ClusterOutput(mass_addition.Result)

# ==== cluster Cluster_7
无烟煤单位热值 = Panel("27.4")
无烟煤单位热值碳排放量 = Panel("94.4")
multiplication = Multiplication(A=无烟煤单位热值, B=无烟煤单位热值碳排放量, C="0.001")
result = ClusterOutput(multiplication)

# ==== cluster Cluster_8
木材单位热值 = Panel("30.5")
木材单位热值碳排放量 = Panel("132")
multiplication = Multiplication(A=木材单位热值, B=木材单位热值碳排放量, C="0.001")
result = ClusterOutput(multiplication)
